# Grasshopper definition CreateInterfaceComplex.gh (Grasshopper 1.0.8)
# plug-ins: GHUI

path = FilePath("C:\Users\Esmaeil Mottaghi\AppData\Roaming\Grasshopper\Libraries\gh-web-ui-0.2.0a\GHUI\Web UI\createdInput.html")

path_2 = FilePath("C:\Users\pmite\Documents\GitHub\gh-web-ui\GHUI\Web UI\createdInput.html")
panel = Panel(path)
html_ui_file_will_be_written_here = Panel(path_2)

# ----
# Create Individual UI Components
panel_2 = Panel("mySlider")
label = CreateLabel(Name="label", ID="myTitle", Value="My Web Interface", Scale=1, CSS="font-family:Arial;")
text = CreateTextInput(Name="text", ID="myTextBox", Value="Name?", CSS="margin-left: 10px;")
button = CreateButton(Name="myButton2", ID="myButton2", Value="Run My Script!")
label_2 = CreateLabel(
    Name="label",
    ID="label",
    Value="A web-based user-interface package for Grasshopper!",
    Scale="3",
    CSS="font-family:Arial;")
slider = CreateSlider(Name=panel_2, ID=panel_2, Value=50, Min=0, Max=100)
slider_2 = CreateSlider(Name="mySlider2", ID="mySlider2", Value=50, Min=0, Max=100)

panel_3 = Panel("Layout")
slider_3 = CreateSlider(HTML=slider_2)
slider_4 = CreateSlider(HTML=slider)

concat = Concatenate(FragmentA=label, FragmentD=label_2, FragmentB=button, FragmentC=text)

# ----
# Create Components to Display Results
panel_4 = Panel("myLabel")
label_3 = CreateLabel(Name="label", ID="label", Value="Distance in Rhino: ", Scale="3", CSS="font-family:Arial;")
label_4 = CreateLabel(Name="label", ID=panel_4, Value="label", Scale="3", CSS="font-family:Arial;")
concat_2 = Concatenate(FragmentA=label_3, FragmentB=label_4)

panel_5 = Panel("Layout & Styling")
div = WrapInDiv(HTML=concat_2, CSS="width:100%; height:100px; background:lightgray;")

concat_3 = Concatenate(FragmentE=concat, FragmentC=slider_4, FragmentB=slider_3, FragmentA=div)
vue_ui = BuildVueUI(HTMLPath=path, HTMLString=concat_3, Title="UI")  # -> Success, Path
panel_6 = Panel(vue_ui.Path)

panel_7 = Panel("Launch Full UI")
html_ui = LaunchHTMLUI(HTMLPath=vue_ui.Path, ShowWindow=Toggle(True), Title="UI")  # -> InputValues, InputIds, InputNames, InputTypes, WebWindow
names_of_inputs = Panel(html_ui.InputNames)
ids_of_inputs = Panel(html_ui.InputIds)
types_of_inputs = Panel(html_ui.InputTypes)
values_of_inputs = Panel(html_ui.InputValues)

# ----
# Use Inputs in Grasshopper!
panel_8 = Panel("3")
item = ListItem(List=values_of_inputs, Index=panel_8, Wrap=True)
item_2 = ListItem(List=values_of_inputs, Index="2", Wrap=True)
pt = ConstructPoint(XCoordinate=item, YCoordinate=item, ZCoordinate=item)
pt_2 = ConstructPoint(XCoordinate=item_2, YCoordinate=item_2, ZCoordinate=item_2)
dist = Distance(PointA=pt, PointB=pt_2)
ln = Line(StartPoint=pt, EndPoint=pt_2)
distance_between_points = Panel(dist)

panel_9 = Panel(concat_3)

# ----
# Set Values Based on Grasshopper-Computed Output
panel_10 = Panel("myLabel")
label_5 = SetLabel(IDs=panel_10, Values=dist)
set_ui = SETHTMLUI(WebWindow=html_ui.WebWindow, Setters=label_5)
