# Grasshopper definition ServeInterface.gh (Grasshopper 1.0.8)
# plug-ins: GHUI

toggle = BooleanToggle(False)
path = FilePath("C:\Users\Esmaeil Mottaghi\AppData\Roaming\Grasshopper\Libraries\gh-web-ui-0.2.0a\GHUI\Web UI\test.html")
ghui = GrasshopperUI(HTMLPath=path, ShowWindow=Button(), Title="UI")  # -> InputValues, InputIds, InputNames, InputTypes, WebWindow
panel = Panel(path)
panel_2 = Panel(ghui.InputTypes)
panel_3 = Panel(ghui.InputIds)
panel_4 = Panel(ghui.InputValues)
panel_5 = Panel(ghui.InputNames)
